# Grasshopper definition t2_demo_model_testing.ghx (Grasshopper 1.0.7)

info = Info()  # -> info
#   port info: Environment info.
# ---------- info: Python ----------
"""
Displays information about the active COMPAS environment.
"""
import compas_bootstrapper
from ghpythonlib.componentbase import executingcomponent as component

import compas


class CompasInfo(component):
    def RunScript(self):
        self.Message = "COMPAS v{}".format(compas.__version__)
        info = "COMPAS Version: {}\nEnvironment: {}"
        return info.format(compas.__version__, compas_bootstrapper.ENVIRONMENT_NAME)
# ---------- end info ----------
panel = Panel(info)
panel_2 = Panel("""0
1
3
2""")  # disabled
crv = Curve([<curve referenced from the Rhino model> x4])  # disabled
crv_2 = Curve([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])
item = ListItem(List=crv, Index=panel_2, Wrap=True)  # disabled
item_2 = ListItem(List=crv_2, Index=0, Wrap=True)  # -> Item, Item1, Item2, Item3
crv_3 = Curve([item_2.Item, item_2.Item1])
crv_4 = Curve([item_2.Item1, item_2.Item3])
item_3 = ListItem(List=item, Index=0, Wrap=True)  # -> Item, Item1, Item2, Item3; disabled
crv_5 = Curve([item_2.Item, item_2.Item2])
flip = FlipCurve(Curve=crv_4)  # -> Curve, Flag
crv_6 = Curve([item_2.Item3, item_2.Item2])
crv_7 = Curve([item_3.Item, item_3.Item1])  # disabled
number_slider = Slider(13, range=0..100)  # disabled
number_slider_2 = Slider(13, range=0..100)  # disabled
crv_8 = Curve([item_3.Item1, item_3.Item3])  # disabled
number_slider_3 = Slider(52, range=0..100)  # disabled
number_slider_4 = Slider(52, range=0..100)  # disabled
number_slider_5 = Slider(13, range=0..100)  # disabled
number_slider_6 = Slider(13, range=0..100)  # disabled
number_slider_7 = Slider(52, range=0..100)  # disabled
number_slider_8 = Slider(52, range=0..100)  # disabled
crv_9 = Curve([item_3.Item, item_3.Item2])  # disabled
flip_2 = FlipCurve(Curve=crv_8)  # -> Curve, Flag; disabled
crv_10 = Curve([item_3.Item3, item_3.Item2])  # disabled
cluster = Cluster_2(centerline=flip.Curve, L=flip.Curve, S=Slider(13, range=0..100), S_2=Slider(52, range=0..100))  # -> relay_2, joints
cluster_2 = Cluster_2(centerline=crv_6, L=crv_6, S=Slider(13, range=0..100), S_2=Slider(52, range=0..100))  # -> relay_2, joints
# Add additional items we had from the previous project.
# 
# Test: Converting it to a network and adding attributes?
# 
# Test: Other type of list and type for item number and data type.
# 
# Figure out: how to get rid of joints in the nodes. Or seperate it some how?
# 
# Confirm structure with Gonzalo, and start DB edits.... Also draw frame, and check where they are.
cluster_3 = Cluster_2(centerline=crv_3, L=crv_3, S=Slider(13, range=0..100), S_2=Slider(52, range=0..100))  # -> relay_2, joints
cluster_4 = Cluster_2(centerline=crv_5, L=crv_5, S=Slider(13, range=0..100), S_2=Slider(52, range=0..100))  # -> relay_2, joints
cluster_5 = Cluster_2(centerline=flip_2.Curve, L=flip_2.Curve, S=number_slider_2, S_2=number_slider_4)  # -> relay_2, joints; disabled
cluster_6 = Cluster_2(centerline=crv_10, L=crv_10, S=number_slider_6, S_2=number_slider_8)  # -> relay_2, joints; disabled
cluster_7 = Cluster_2(centerline=crv_7, L=crv_7, S=number_slider_5, S_2=number_slider_7)  # -> relay_2, joints; disabled
cluster_8 = Cluster_2(centerline=crv_9, L=crv_9, S=number_slider, S_2=number_slider_3)  # -> relay_2, joints; disabled
merge = Merge(Data1=cluster_3.relay_2, Data2=cluster.relay_2, Data3=cluster_4.relay_2, Data4=cluster_2.relay_2)
merge_2 = Merge(Data1=cluster_3.joints, Data2=cluster.joints, Data3=cluster_4.joints, Data4=cluster_2.joints)
toggle = BooleanToggle(True)  # disabled
merge_3 = Merge(Data1=cluster_7.relay_2, Data2=cluster_5.relay_2, Data3=cluster_8.relay_2, Data4=cluster_6.relay_2)  # disabled
assembly = COMPAS_TIMBERAssembly(Beams=flatten(merge), Joints=flatten(merge_2), applyFeatures=Toggle(True))  # -> Assembly, Errors; inputs Beams: list, Joints: list, Features: list, applyFeatures: Boolean
#   port Beams: Collection of Beams
# ---------- assembly: Python ----------
from ghpythonlib.componentbase import executingcomponent as component
from Grasshopper.Kernel.GH_RuntimeMessageLevel import Warning

from compas_timber.assembly import TimberAssembly


class Assembly(component):
    def __init__(self):
        # maintains relationship of old_beam.id => new_beam_obj for referencing
        # lets us modify copies of the beams while referencing them using their old identities.
        self._beam_map = {}

    def _get_copied_beams(self, old_beams):
        """For the given old_beams returns their respective copies."""
        new_beams = []
        for beam in old_beams:
            new_beams.append(self._beam_map[id(beam)])
        return new_beams

    def RunScript(self, Beams, Joints, Features, applyFeatures):
        if not Beams:
            self.AddRuntimeMessage(Warning, "Input parameter 'Beams' failed to collect data")
            return

        Assembly = TimberAssembly()
        self._beam_map = {}
        beams = [b for b in Beams if b is not None]
        for beam in beams:
            c_beam = beam.copy()
            Assembly.add_beam(c_beam)
            self._beam_map[id(beam)] = c_beam
        beams = Assembly.beams

        if Joints:
            handled_beams = []
            joints = [j for j in Joints if j is not None]
            # apply reversed. later joints in orginal list override ealier ones
            for joint in joints[::-1]:
                beams_to_pair = self._get_copied_beams(joint.beams)
                beam_pair_ids = set([id(beam) for beam in beams_to_pair])
                if beam_pair_ids in handled_beams:
                    continue
                joint.joint_type.create(Assembly, *beams_to_pair)
                handled_beams.append(beam_pair_ids)

        Errors = []

        if Features:
            features = [f for f in Features if f is not None]
            for f_def in features:
                beams_to_modify = self._get_copied_beams(f_def.beams)
                for beam in beams_to_modify:
                    beam.add_feature(f_def.feature)
        if applyFeatures:
            for beam in Assembly.beams:
                Errors.extend(beam.apply_features())

        return Assembly, Errors
# ---------- end assembly ----------
merge_4 = Merge(Data1=cluster_7.joints, Data2=cluster_5.joints, Data3=cluster_8.joints, Data4=cluster_6.joints)  # disabled
data = Data(null)
assembly_2 = COMPAS_TIMBERAssembly(Beams=flatten(merge_3), Joints=flatten(merge_4), applyFeatures=toggle)  # -> Assembly, Errors; inputs Beams: list, Joints: list, Features: list, applyFeatures: Boolean; disabled; same code as assembly

panel_3 = Panel("X:\GKR_working\Fall_2023\working_local\compas_xr_local\10162023_weeklywork\compas_timbers_working\json_tests\")
ghpython_script = GhPythonScript(filename=panel_3, number=Slider(11, range=0..100))  # -> out, a
# ---------- ghpython_script: Python ----------
a = filename + str(number) + ".json"
# ---------- end ghpython_script ----------

# ----
# Actual: Working in Rhino GH (I believe... needs checking and confirmation with Daniela)
# TODO: CONFIRM IF WE SHOULD USE OFFSET FRAME FOR THE ADDITION VECTOR
# - IF WE DO THIS THEN FRAME NEEDS TO BE OVERWRITTEN BY THE OFFSET FRAME, BUT ALSO JOINTS INFO INCLUDES NO INFORMATION
data_type = ValueList({"Cylinder": 0, "Box": 1, "ObjFile": 2, "Mesh": 3}, selected="ObjFile")
robot_keys = Panel("""0
9
19
28
38
47
56
66
75""")
is_built = Panel("""6
8
12
9""")
is_planned = Panel("""6
8
12
9""")
ghpython_script_2 = GhPythonScript(assembly=assembly.Assembly, data_type=data_type, built_keys=is_built, planned_keys=is_planned, offset=Toggle(False))  # -> out, data, beam_keys, joint_keys, planes; inputs robot_keys: list of Int32, built_keys: list, planned_keys: list, offset: Boolean
# ---------- ghpython_script_2: Python ----------
import compas
from compas.datastructures import Assembly
from compas.datastructures import Network
from compas.data import json_dumps,json_loads
from compas.geometry import scale_vector, add_vectors
from compas.data import Data
from compas.geometry import Frame
from compas.artists import Artist
from compas_timber import parts as part
from compas_timber import connections

#from compas_timber import assembly


def offset_frame_xaxis(frame, distance):
    
    frame = frame.copy()
    offset_frame = frame.copy()
        
    if distance > 0:
        frame_xaxis = offset_frame.xaxis
        frame_xaxis_scaled = scale_vector(frame_xaxis, distance)
        new_frame_origin = add_vectors(offset_frame.point, frame_xaxis_scaled)
        offset_frame = Frame(new_frame_origin, offset_frame.xaxis, offset_frame.yaxis)
    
    return offset_frame

data_type_list = ['Cylinder','Box','ObjFile','Mesh']

data = assembly.data
part_keys = assembly.part_keys
#assembly_no_joints = assembly.beams

data = [data]
data_nodes = data[0]['graph']['node']
length = len(data_nodes)
joints = {}
planes = []
joint_keys = []
beam_keys = []

#Don't actually need to do just for visualization
for i in data_nodes:
    
    if data_nodes[i]['type'] == 'part_beam':
        
        frame_original = data_nodes[i]['part'].frame
        if offset:
            length = data_nodes[i]['part'].length
            frame = offset_frame_xaxis(frame_original, (length/2))
            planes.append(frame)
        else:
            frame = frame_original
            planes.append(frame)
    #This actually needs to be done
    else:
        joints.update({str(i): data_nodes[i]})
        joint_keys.append(i)

#print data_nodes

for item in joint_keys:
    data_nodes.pop(item)

for key in data_nodes:
    data_nodes[key]['type_id'] = key
    data_nodes[key]['type_data'] = data_type_list[data_type]
    data_nodes[key]['is_built'] = False
    data_nodes[key]['is_planned'] = False
    data_nodes[key]['placed_by'] = "human"
    beam_keys.append(key)

for k in robot_keys:
    data_nodes[str(k)]['placed_by'] = "robot"
    

if built_keys:
    for l in built_keys:
            data_nodes[l]['is_built'] = True

if planned_keys:
    for m in planned_keys:
            data_nodes[m]['is_planned'] = True

data[0]['graph']['joints'] = joints
# ---------- end ghpython_script_2 ----------
draw = Draw(cg=ghpython_script_2.planes)  # -> rg
#   port cg: The COMPAS geometry or datastructure to be drawn.
# ---------- draw: Python ----------
from compas_rhino.conversions import frame_to_rhino
rg = frame_to_rhino(cg)
# ---------- end draw ----------
panel_4 = Panel(ghpython_script_2.beam_keys)

# ----
# TRY TO ACCESS: Joint frames
data_type_2 = ValueList({"Cylinder": 0, "Box": 1, "ObjFile": 2, "Mesh": 3}, selected="ObjFile")
is_built_2 = Panel("""6
8
12
9""")
is_planned_2 = Panel("""6
8
12
9""")
ghpython_script_3 = GhPythonScript(
    assembly=assembly.Assembly,
    data_type=data_type_2,
    built_keys=is_built_2,
    planned_keys=is_planned_2,
    offset=Toggle(False))  # -> out, data, beam_keys, joint_keys, midpoints, planes; inputs robot_keys: list of Int32, built_keys: list, planned_keys: list, offset: Boolean
# ---------- ghpython_script_3: Python ----------
import compas
from compas.datastructures import Assembly
from compas.datastructures import Network
from compas.data import json_dumps,json_loads
from compas.geometry import scale_vector, add_vectors
from compas.data import Data
from compas.geometry import Frame
from compas.artists import Artist
from compas_timber import parts as part
from compas_timber import connections
from compas_timber import parts

#from compas_timber import assembly


def offset_frame_xaxis(frame, distance):
    
    frame = frame.copy()
    offset_frame = frame.copy()
        
    if distance > 0:
        frame_xaxis = offset_frame.xaxis
        frame_xaxis_scaled = scale_vector(frame_xaxis, distance)
        new_frame_origin = add_vectors(offset_frame.point, frame_xaxis_scaled)
        offset_frame = Frame(new_frame_origin, offset_frame.xaxis, offset_frame.yaxis)
    
    return offset_frame

data_type_list = ['Cylinder','Box','ObjFile','Mesh']

data = assembly.data
assembly_beams = assembly.beams
assembly_beam_keys = assembly.beam_keys
assembly_joint_keys = assembly.joint_keys
print assembly_joint_keys
#print (assembly_beams)
graph = assembly.graph.to_data()

#print type(graph)
#print (type(data))
#data_test = assembly.to_data
#print type(data_test)
#compas_data = Data.from_data(graph)
part_keys = assembly.part_keys
#assembly_no_joints = assembly.beams

data = [data]
data_nodes = graph['node']
length = len(data_nodes)
joints = {}
planes = []
joint_keys = []
joint_frames = []
beam_keys = []
mid_points = []

#Assembly attributes should be added like this.
#graph = assembly.graph.node_attribute()

#Don't actually need to do just for visualization
for i in data_nodes:
    
    if data_nodes[i]['type'] == 'part_beam':
        frame_original = data_nodes[i]['part'].frame
        midpoint = data_nodes[i]['part'].midpoint
        mid_points.append(midpoint)
        if offset:
            length = data_nodes[i]['part'].length
            frame = offset_frame_xaxis(frame_original, (length/2))
            planes.append(frame)
            

        else:
            frame = frame_original
            planes.append(frame)
    #This actually needs to be done
    else:
        
        connecting_beams = data_nodes[i]['part'].beams
        #        joint_frame = data_nodes[i]['part'].cutting_plane_main
        
        joints.update({str(i): data_nodes[i]})
        joint_keys.append(i)

#print data_nodes

for item in joint_keys:
    data_nodes.pop(item)

for key in data_nodes:
    data_nodes[key]['type_id'] = key
    data_nodes[key]['type_data'] = data_type_list[data_type]
    data_nodes[key]['is_built'] = False
    data_nodes[key]['is_planned'] = False
    data_nodes[key]['placed_by'] = "human"
    beam_keys.append(key)

for k in robot_keys:
    data_nodes[str(k)]['placed_by'] = "robot"
    

if built_keys:
    for l in built_keys:
            data_nodes[l]['is_built'] = True

if planned_keys:
    for m in planned_keys:
            data_nodes[m]['is_planned'] = True

data[0]['graph']['joints'] = joints
# ---------- end ghpython_script_3 ----------
draw_2 = Draw(cg=ghpython_script_3.planes)  # -> rg; same code as draw
# this can be changed: For key in beam_keys:
# 	Add attributes we need
# 
# For key in joint_keys:
# dont add anything
panel_5 = Panel(ghpython_script_3.beam_keys)

to_json = ToJSON(data=ghpython_script_2.data, filepath=ghpython_script.a, pretty=Toggle(True))  # -> json; inputs pretty: Boolean; disabled
#   port data: COMPAS data objects to serialize.
#   port filepath: File path where to store the JSON file. If empty, it will not store to disk but instead return the JSON string.
#   port pretty: If True, JSON data will be formatted with indentation and key sorting.
#   port json: JSON file path or JSON string.
# ---------- to_json: Python ----------
"""
Serializes COMPAS objects to JSON.
"""
from ghpythonlib.componentbase import executingcomponent as component

import compas


class CompasInfo(component):
    def RunScript(self, data, filepath, pretty):
        json = filepath

        if filepath:
            compas.json_dump(data, filepath, pretty)
        else:
            json = compas.json_dumps(data, pretty)

        return json
# ---------- end to_json ----------
showassembly = COMPAS_TIMBERShowAssembly(Assembly=assembly_2.Assembly)  # -> Brep; disabled
#   port Assembly: Assembly object.
# ---------- showassembly: Python ----------
from compas.artists import Artist
from ghpythonlib.componentbase import executingcomponent as component
from Grasshopper.Kernel.GH_RuntimeMessageLevel import Warning


class ShowAssembly(component):
    def RunScript(self, Assembly):
        if not Assembly:
            self.AddRuntimeMessage(Warning, "Input parameter Assembly failed to collect data")
            return

        Brep = []
        for beam in Assembly.beams:
            Brep.append(Artist(beam.geometry, context="Grasshopper").draw())

        return Brep
# ---------- end showassembly ----------
showassembly_2 = COMPAS_TIMBERShowAssembly(Assembly=assembly.Assembly)  # -> Brep; same code as showassembly

# ----
# Genaric Assembly and Data
ghpython_script_4 = GhPythonScript()  # -> out, assembly, assembly_data, frame_data
# ---------- ghpython_script_4: Python ----------
from compas.datastructures import Assembly, Part
from compas.geometry import Frame
from compas.data import json_dumps
from compas.data import Data

p1 = Part("part1", frame=Frame.worldXY())
p2 = Part("part2", frame=Frame.worldXY())

assembly = Assembly()

assembly.add_part(p1)
assembly.add_part(p2)
assembly.add_connection(p1, p2)

assembly_data = assembly.to_data()


#print(json_dumps(assembly, pretty=True))
# ---------- end ghpython_script_4 ----------

data_2 = Data("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")  # disabled

# ----
# Genaric Assembly and Data
ghpython_script_5 = GhPythonScript()  # -> out, assembly, assembly_data, frame_data
# ---------- ghpython_script_5: Python ----------
from compas.datastructures import Assembly, Part
from compas.geometry import Frame
from compas.data import json_dumps
from compas.data import Data

p1 = Part("part1", frame=Frame.worldXY())
p2 = Part("part2", frame=Frame.worldXY())

assembly = Assembly()

assembly.add_part(p1)
assembly.add_part(p2)
assembly.add_connection(p1, p2)

assembly_data = assembly.to_data()


for part in assembly.parts():
    data = part.to_data()
#    print type(data)
    frame = part.frame
    print type(frame)
    
    frame_data = frame.to_data()
    print type(frame_data)
#    print type(frame_data)
    

frame_data = [frame_data]
data = [data]
assembly_data = [assembly_data]

#print(json_dumps(assembly, pretty=True))
# ---------- end ghpython_script_5 ----------

ghpython_script_6 = GhPythonScript(x=data_2)  # -> out, a; disabled
# ---------- ghpython_script_6: Python ----------
from compas.datastructures import Assembly
from compas.data import json_loads, json_dumps

assembly_data = json_loads(x)
a = Assembly(assembly_data)
# ---------- end ghpython_script_6 ----------
data_3 = Data("X:\GKR_working\Fall_2023\git_working\compas_xr")
py = PythonScript(path=data_3)  # -> DATA
# ---------- py: Python ----------
import os
import getpass

username = getpass.getuser()
DATA = os.path.abspath(os.path.join(path + "/data"))

print(username)
print(DATA)
# ---------- end py ----------

panel_6 = Panel(".json")
# Firebase Storage
# Upload File: Working
panel_7 = Panel("random.json")
button = Button()
py_2 = PythonScript(path=data_3)  # -> DATA; same code as py
ghpython_script_7 = GhPythonScript(DATA=py_2, path=data_3, filename=panel_7, upload=Toggle(False))  # inputs upload: Boolean
# ---------- ghpython_script_7: Python ----------
from compas_rhino import unload_modules
unload_modules('compas_xr')

import sys
import os

from compas_xr.storage import Storage
from compas.data import json_dumps
#

path_on_cloud = str(filename)
PATH = os.path.join(DATA, filename)
print PATH

if not config_filename:
    canvas = ghenv.Component.OnPingDocument()
    folder = os.path.dirname(canvas.FilePath)
    config_filename = os.path.join(folder, "firebase_config.json")

if config_filename:
    canvas = ghenv.Component.OnPingDocument()
    folder = os.path.dirname(canvas.FilePath)
    config_filename = os.path.join(folder, config_filename)


st = Storage(config_filename)
#st.download_file("assembly_structure.json", r"X:\GKR_working\Fall_2023\git_working\compas_xr\data\assembly_structure_test.json")

#print(json_dumps(st))

if upload:
    PATH = os.path.join(DATA, filename)
    print (filename)
    path_on_cloud = filename
    path_local = PATH
    print(path_local)
    print(path_on_cloud)
    upload = st.upload_file(path_on_cloud, path_local)
#    
#    if upload == True:
#        ghenv.Component.Message = "Json Uploaded"
#    else:
#        ghenv.Component.Message = "Json failed to upload"
# ---------- end ghpython_script_7 ----------

# ----
# Upload Assembly: Working
panel_8 = Panel("assembly_upload_timbers.json")
button_2 = Button()
ghpython_script_8 = GhPythonScript(assembly=assembly.Assembly, path=data_3, filename=panel_8, upload=Toggle(False))  # inputs upload: Boolean
# ---------- ghpython_script_8: Python ----------
from compas_rhino import unload_modules
unload_modules('compas_xr')

import sys
import os

from compas_xr.storage import Storage
from compas.data import json_dumps
#

path_on_cloud = str(filename)

if not config_filename:
    canvas = ghenv.Component.OnPingDocument()
    folder = os.path.dirname(canvas.FilePath)
    config_filename = os.path.join(folder, "firebase_config.json")

if config_filename:
    canvas = ghenv.Component.OnPingDocument()
    folder = os.path.dirname(canvas.FilePath)
    config_filename = os.path.join(folder, config_filename)


st = Storage(config_filename)
#st.download_file("assembly_structure.json", r"X:\GKR_working\Fall_2023\git_working\compas_xr\data\assembly_structure_test.json")

#print(json_dumps(st))

if upload:
    print (filename)
    path_on_cloud = filename
    print(path_on_cloud)
    upload = st.upload_assembly(path_on_cloud, assembly)
#    
#    if upload == True:
#        ghenv.Component.Message = "Assembly Uploaded"
#    else:
#        ghenv.Component.Message = "Assembly failed to upload"
# ---------- end ghpython_script_8 ----------

# ----
# Download File: Working
panel_11 = Panel("assembly_structure.json")
button_3 = Button()
py_3 = PythonScript(path=data_3)  # -> DATA; same code as py
ghpython_script_9 = GhPythonScript(DATA=py_3, path=data_3, filename=panel_11, download=Toggle(False))  # -> out, json; inputs download: Boolean
# ---------- ghpython_script_9: Python ----------
from compas_rhino import unload_modules
unload_modules('compas_xr')

import sys
import os
import json

from compas_xr.storage import Storage
from compas.data import json_dumps
#

path_on_cloud = str(filename)
PATH = os.path.join(DATA, filename)
print PATH

if not config_filename:
    canvas = ghenv.Component.OnPingDocument()
    folder = os.path.dirname(canvas.FilePath)
    config_filename = os.path.join(folder, "firebase_config.json")

elif config_filename:
    canvas = ghenv.Component.OnPingDocument()
    folder = os.path.dirname(canvas.FilePath)
    config_filename = os.path.join(folder, config_filename)


st = Storage(config_filename)
#st.download_file("assembly_structure.json", r"X:\GKR_working\Fall_2023\git_working\compas_xr\data\assembly_structure_test.json")

#print(json_dumps(st))

if download:
    PATH = os.path.join(DATA, filename)
    print (filename)
    path_on_cloud = filename
    path_local = PATH
    print(path_local)
    print(path_on_cloud)
    result = st.download_file(path_on_cloud, path_local)

if os.path.exists(PATH):
    with open(PATH) as json_file:
        json = [json.load(json_file)]
# ---------- end ghpython_script_9 ----------

# ----
# Download Assembly: Works, but not sure if its the best way.... also, works with both timbers and compas Assembly.
panel_13 = Panel("assembly_upload_timbers.json")
button_4 = Button()
py_4 = PythonScript(path=data_3)  # -> DATA; same code as py
ghpython_script_10 = GhPythonScript(DATA=py_4, path=data_3, filename=panel_13, download=Toggle(False))  # -> out, assembly; inputs download: Boolean
# ---------- ghpython_script_10: Python ----------
from compas_rhino import unload_modules
unload_modules('compas_xr')

import sys
import os

from compas_xr.storage import Storage
from compas.data import json_dumps
#

path_on_cloud = str(filename)
PATH = os.path.join(DATA, filename)
print PATH

if not config_filename:
    canvas = ghenv.Component.OnPingDocument()
    folder = os.path.dirname(canvas.FilePath)
    config_filename = os.path.join(folder, "firebase_config.json")

elif config_filename:
    canvas = ghenv.Component.OnPingDocument()
    folder = os.path.dirname(canvas.FilePath)
    config_filename = os.path.join(folder, config_filename)


st = Storage(config_filename)
#st.download_file("assembly_structure.json", r"X:\GKR_working\Fall_2023\git_working\compas_xr\data\assembly_structure_test.json")

#print(json_dumps(st))

if download:
    PATH = os.path.join(DATA, filename)
    print (filename)
    path_on_cloud = filename
    path_local = PATH
    print(path_local)
    print(path_on_cloud)
    assembly = st.download_assembly(path_on_cloud, path_local)
# ---------- end ghpython_script_10 ----------

# ----
# Upload Data: Working
panel_15 = Panel("data_upload_frame.json")
button_5 = Button()
ghpython_script_11 = GhPythonScript(path=data_3, filename=panel_15, upload=Toggle(False))  # inputs upload: Boolean
# ---------- ghpython_script_11: Python ----------
from compas_rhino import unload_modules
unload_modules('compas_xr')

import sys
import os

from compas_xr.storage import Storage
from compas.data import json_dumps
#

path_on_cloud = str(filename)

if not config_filename:
    canvas = ghenv.Component.OnPingDocument()
    folder = os.path.dirname(canvas.FilePath)
    config_filename = os.path.join(folder, "firebase_config.json")

if config_filename:
    canvas = ghenv.Component.OnPingDocument()
    folder = os.path.dirname(canvas.FilePath)
    config_filename = os.path.join(folder, config_filename)


st = Storage(config_filename)
#st.download_file("assembly_structure.json", r"X:\GKR_working\Fall_2023\git_working\compas_xr\data\assembly_structure_test.json")

#print(json_dumps(st))

if upload:
    print (filename)
    path_on_cloud = filename
    print(path_on_cloud)
    upload = st.upload_data(path_on_cloud, data)
#    print upload
#    if upload == True:
#        ghenv.Component.Message = "Data Uploaded"
#    else:
#        ghenv.Component.Message = "Data failed to upload"
# ---------- end ghpython_script_11 ----------

# ----
# Download data: Working
panel_17 = Panel("data_upload_frame.json")
button_6 = Button()
py_5 = PythonScript(path=data_3)  # -> DATA; same code as py
data_4 = GhPythonScript(DATA=py_5, path=data_3, filename=panel_17, download=Toggle(True))  # -> out, data; inputs download: Boolean
# ---------- data_4: Python ----------
from compas_rhino import unload_modules
unload_modules('compas_xr')

import sys
import os

from compas_xr.storage import Storage
from compas.data import json_dumps
#

path_on_cloud = str(filename)
PATH = os.path.join(DATA, filename)
print PATH

if not config_filename:
    canvas = ghenv.Component.OnPingDocument()
    folder = os.path.dirname(canvas.FilePath)
    config_filename = os.path.join(folder, "firebase_config.json")

elif config_filename:
    canvas = ghenv.Component.OnPingDocument()
    folder = os.path.dirname(canvas.FilePath)
    config_filename = os.path.join(folder, config_filename)


st = Storage(config_filename)
#st.download_file("assembly_structure.json", r"X:\GKR_working\Fall_2023\git_working\compas_xr\data\assembly_structure_test.json")

#print(json_dumps(st))

if download:
    PATH = os.path.join(DATA, filename)
    print (filename)
    path_on_cloud = filename
    path_local = PATH
    print(path_local)
    print(path_on_cloud)
    data = st.download_data(path_on_cloud, path_local)
    data = [data]
# ---------- end data_4 ----------

ghpython_script_12 = GhPythonScript(frame_data=data_4.data)  # -> out, a
# ---------- ghpython_script_12: Python ----------
from compas.datastructures import Assembly
from compas.geometry import Frame

if assembly_data:
    a = Assembly.from_data(assembly_data)

if frame_data:
    a = Frame.from_data(frame_data)
# ---------- end ghpython_script_12 ----------

# ==== cluster Cluster_2
i = Index(1)
L = ClusterInput()
S = ClusterInput()
S_2 = ClusterInput()
cluster = Cluster(L=L, S=S, S_2=S_2)  # -> S_3, M, L_2
split = SplitList(List=cluster.M, Index=i)  # -> ListA, reverse(ListB)
split_2 = SplitList(List=split.ListB, Index=i)  # -> ListA, ListB
number_slider = Slider(200, range=0..200)
number_slider_2 = Slider(50, range=0..100)
number_slider_3 = Slider(100, range=0..100)
number_slider_4 = Slider(100, range=0..100)
Z = UnitZ(Factor=1)
Z_2 = UnitZ(Factor=1)
Y = UnitY(Factor=1)
Y_2 = UnitY(Factor=1)
jointtype = JointTypeSelection({"T-Butt", "L-Butt", "L-Miter"}, selected="L-Butt")
jointtype_2 = JointTypeSelection({"T-Butt", "L-Butt", "L-Miter"}, selected="T-Butt")
jointtype_3 = JointTypeSelection({"T-Butt", "L-Butt", "L-Miter"}, selected="T-Butt")
jointtype_4 = JointTypeSelection({"T-Butt", "L-Butt", "L-Miter"}, selected="T-Butt")
centerline = ClusterInput()
jointcategoryrule = COMPAS_TIMBERJointCategoryRule(JointType=jointtype, CatA="edge", CatB="big")  # -> Rule
# ---------- jointcategoryrule: Python ----------
from ghpythonlib.componentbase import executingcomponent as component

from compas_timber.connections import LButtJoint
from compas_timber.connections import LMiterJoint
from compas_timber.connections import TButtJoint
from compas_timber.connections import XHalfLapJoint
from compas_timber.ghpython import CategoryRule


class JointCategoryRule(component):
    # TODO: auto fill with subclasses of Joint
    MAP = {"T-Butt": TButtJoint, "L-Miter": LMiterJoint, "L-Butt": LButtJoint, "X-HalfLap": XHalfLapJoint}

    def RunScript(self, JointType, CatA, CatB):
        if JointType and CatA and CatB:
            return CategoryRule(self.MAP[JointType], CatA, CatB)
# ---------- end jointcategoryrule ----------
beam = COMPAS_TIMBERBeam(Centerline=cluster.S_3, ZVector=Y, Width=number_slider_2, Height=number_slider_2, Category="small")  # -> Beam; inputs Centerline: list of Curve, ZVector: list of Vector3d, Width: list, Height: list, Category: list
#   port Centerline: Referenced curve or line, Guid of curve or line in the active Rhino document.
#   port ZVector: Vector defining the orientation of the cross-section (corresponds to the height dimension). If None, a default will be taken.
#   port Width: Width of the cross-section (usually the smaller dimension).
#   port Height: Height of the cross-section (usually the larger dimension).
#   port Category: Category of a beam.
#   port Beam: Beam object(s).
# ---------- beam: Python ----------
"""Creates a Beam from a LineCurve."""
import Rhino.Geometry as rg
from compas_rhino.conversions import line_to_compas
from compas_rhino.conversions import vector_to_compas
from ghpythonlib.componentbase import executingcomponent as component
from Grasshopper.Kernel.GH_RuntimeMessageLevel import Error
from Grasshopper.Kernel.GH_RuntimeMessageLevel import Warning

from compas_timber.parts.beam import Beam as ctBeam


class Beam_fromCurve(component):
    def RunScript(self, Centerline, ZVector, Width, Height, Category):
        # minimum inputs required
        if not Centerline:
            self.AddRuntimeMessage(Warning, "Input parameter 'Centerline' failed to collect data")
        if not Width:
            self.AddRuntimeMessage(Warning, "Input parameter 'Width' failed to collect data")
        if not Height:
            self.AddRuntimeMessage(Warning, "Input parameter 'Height' failed to collect data")

        # reformat unset parameters for consistency
        if not ZVector:
            ZVector = [None]
        if not Category:
            Category = [None]

        Beam = []

        if Centerline and Height and Width:
            # check list lengths for consistency
            N = len(Centerline)
            if len(ZVector) not in (0, 1, N):
                self.AddRuntimeMessage(
                    Error, " In 'ZVector' I need either none, one or the same number of inputs as the Crv parameter."
                )
            if len(Width) not in (1, N):
                self.AddRuntimeMessage(
                    Error, " In 'W' I need either one or the same number of inputs as the Crv parameter."
                )
            if len(Height) not in (1, N):
                self.AddRuntimeMessage(
                    Error, " In 'H' I need either one or the same number of inputs as the Crv parameter."
                )
            if len(Category) not in (0, 1, N):
                self.AddRuntimeMessage(
                    Error, " In 'Category' I need either none, one or the same number of inputs as the Crv parameter."
                )

            # duplicate data if None or single value
            if len(ZVector) != N:
                ZVector = [ZVector[0] for _ in range(N)]
            if len(Width) != N:
                Width = [Width[0] for _ in range(N)]
            if len(Height) != N:
                Height = [Height[0] for _ in range(N)]
            if len(Category) != N:
                Category = [Category[0] for _ in range(N)]

            for crv, z, w, h, c in zip(Centerline, ZVector, Width, Height, Category):
                if crv is None or w is None or h is None:
                    self.AddRuntimeMessage(Warning, "Some of the input values are Null")
                else:
                    line = rg.Line(crv.PointAtStart, crv.PointAtEnd)

                    line = line_to_compas(line)
                    if z:
                        z = vector_to_compas(z)
                    else:
                        None

                    beam = ctBeam.from_centerline(centerline=line, width=w, height=h, z_vector=z, geometry_type="brep")

                    beam.attributes["rhino_guid"] = None
                    beam.attributes["category"] = c

                    Beam.append(beam)

        return Beam
# ---------- end beam ----------
jointcategoryrule_2 = COMPAS_TIMBERJointCategoryRule(JointType=jointtype_2, CatA="small", CatB="med")  # -> Rule; same code as jointcategoryrule
beam_2 = COMPAS_TIMBERBeam(Centerline=centerline, ZVector=Z_2, Width=number_slider, Height=number_slider, Category="big")  # -> Beam; inputs Centerline: list of Curve, ZVector: list of Vector3d, Width: list, Height: list, Category: list; same code as beam
jointcategoryrule_3 = COMPAS_TIMBERJointCategoryRule(JointType=jointtype_3, CatA="med", CatB="big")  # -> Rule; same code as jointcategoryrule
beam_3 = COMPAS_TIMBERBeam(Centerline=split_2.ListB, ZVector=Y_2, Width=number_slider_3, Height=number_slider_3, Category="med")  # -> Beam; inputs Centerline: list of Curve, ZVector: list of Vector3d, Width: list, Height: list, Category: list; same code as beam
jointcategoryrule_4 = COMPAS_TIMBERJointCategoryRule(JointType=jointtype_4, CatA="small", CatB="edge")  # -> Rule; same code as jointcategoryrule
beam_4 = COMPAS_TIMBERBeam(Centerline=[split.ListA, split_2.ListA], ZVector=Z, Width=number_slider_4, Height=number_slider_4, Category="edge")  # -> flatten(Beam); inputs Centerline: list of Curve, ZVector: list of Vector3d, Width: list, Height: list, Category: list; same code as beam
i_2 = Index(1)
split_3 = SplitList(List=beam_4, Index=i_2)  # -> ListA, reverse(ListB)
split_4 = SplitList(List=split_3.ListB, Index=i_2)  # -> ListA, ListB
relay = Relay([beam_2, beam_4, beam_3, beam])
relay_2 = ClusterOutput(relay)
automaticjoints = COMPAS_TIMBERAutomaticJoints(Beams=flatten(relay), Rules=[jointcategoryrule_3, jointcategoryrule_2, jointcategoryrule_4, jointcategoryrule])  # -> Joints, Info; inputs Beams: list, Rules: list
#   port Beams: Collection of Beams.
# ---------- automaticjoints: Python ----------
from ghpythonlib.componentbase import executingcomponent as component
from Grasshopper.Kernel.GH_RuntimeMessageLevel import Warning

from compas_timber.connections import ConnectionSolver
from compas_timber.connections import JointTopology
from compas_timber.ghpython import JointDefinition


class AutotomaticJoints(component):
    def RunScript(self, Beams, Rules, MaxDistance):
        if not Beams:
            self.AddRuntimeMessage(Warning, "Input parameter Beams failed to collect data")
        if not Rules:
            self.AddRuntimeMessage(Warning, "Input parameter Rules failed to collect data")
        if not (Beams and Rules):
            return

        if not isinstance(Rules, list):
            Rules = [Rules]
        rules = [r for r in Rules if r is not None]

        solver = ConnectionSolver()
        found_pairs = solver.find_intersecting_pairs(Beams, rtree=True, max_distance=MaxDistance)
        Joints = []
        Info = []
        # rules have to be resolved into joint definitions
        for pair in found_pairs:
            beam_a, beam_b = pair
            detected_topo, beam_a, beam_b = solver.find_topology(beam_a, beam_b, max_distance=MaxDistance)

            if detected_topo == JointTopology.TOPO_UNKNOWN:
                continue

            for rule in rules:
                if not rule.comply(pair):
                    continue
                if rule.joint_type.SUPPORTED_TOPOLOGY != detected_topo:
                    msg = "Conflict detected! Beams: {}, {} meet with topology: {} but rule assigns: {}"
                    Info.append(
                        msg.format(beam_a, beam_b, JointTopology.get_name(detected_topo), rule.joint_type.__name__)
                    )
                    continue
                # sort by category to allow beam role by order (main beam first, cross beam second)
                beam_a, beam_b = rule.reorder([beam_a, beam_b])
                Joints.append(JointDefinition(rule.joint_type, [beam_a, beam_b]))
                break  # first matching rule

        return Joints, Info
# ---------- end automaticjoints ----------
joints = ClusterOutput(automaticjoints.Joints)

# ==== cluster Cluster
S = ClusterInput()
S_2 = ClusterInput()
L = ClusterInput()
item = ListItem(List=L, Index=0, Wrap=True)  # -> Item, Item1
end = EndPoints(Curve=item.Item)  # -> Start, End
end_2 = EndPoints(Curve=item.Item1)  # -> Start, End
ln = Line(StartPoint=end.End, EndPoint=end_2.End)
ln_2 = Line(StartPoint=end.Start, EndPoint=end_2.Start)
series = Series(Start=Slider(0.1, range=0..1), Step=Slider(0.2, range=0..1), Count=Slider(4, range=0..10))
L_2 = ClusterOutput(L)

number_slider = Slider(1, range=0..10)
panel = Panel("""0
0
1
0""")

random = Random(Range=Domain(0, 1), Number=number_slider, Seed=S)
random_2 = Random(Range=Domain(0, 1), Number=number_slider, Seed=S_2)
sort = SortList(Keys=random)  # -> Keys, ValuesA
sort_2 = SortList(Keys=random_2)  # -> Keys, ValuesA
eval = EvaluateCurve(Curve=reparameterize(graft(item.Item)), Parameter=graft(sort.Keys))  # -> Point, Tangent, Angle
eval_2 = EvaluateCurve(Curve=reparameterize(graft(item.Item1)), Parameter=graft(sort_2.Keys))  # -> Point, Tangent, Angle
ln_3 = Line(StartPoint=eval.Point, EndPoint=eval_2.Point)  # -> flatten(Line)
merge = Merge(Data1=ln_2, Data2=ln_3, Data3=ln)
lng = ListLength(List=merge)
series_2 = Series(Start=S_2, Step=1, Count=expr("x+2", lng))
random_3 = Random(Range=Domain(-0.08, 0.08), Number=Slider(4, range=0..10), Seed=series_2)
addition = Addition(A=series, B=random_3)
eval_3 = EvaluateCurve(Curve=reparameterize(graft(merge)), Parameter=addition)  # -> Point, Tangent, Angle
split = SplitTree(Data=eval_3.Point, Masks=flatten("{0;0;0}"))  # -> Positive, Negative
split_2 = SplitTree(Data=eval_3.Point, Masks=flatten("{0;0;4}"))  # -> Positive, Negative
match_paths = MatchPaths(TargetData=flatten(split.Negative), SourceData=split_2.Negative)  # -> RestructuredData, IndexMap
ln_4 = Line(StartPoint=match_paths.RestructuredData, EndPoint=split_2.Negative)
clean = CleanTree(RemoveNulls=True, RemoveInvalid=True, RemoveEmpty=False, Tree=ln_4)  # -> flatten(Tree)

cull_pattern = CullPattern(List=clean, CullPattern=panel)

S_3 = ClusterOutput(cull_pattern)
M = ClusterOutput(merge)
